# Grasshopper definition citygan.gh (Grasshopper 1.0.7)
# plug-ins: Pufferfish, Anemone

genes = GenePool(Decimals=2, Maximum=100, Minimum=0, Value=[50, 50, 50, 50, 50, 50, 50, 50, 50, 50])
crv = Curve(<curve referenced from the Rhino model>)
python = PythonScript()  # -> rhino_doc_dir
# ---------- python: Python ----------
import scriptcontext as sc
from os import path

rhino_doc_dir = path.abspath(path.dirname(sc.doc.Path))
# ---------- end python ----------
number_slider = Slider(16, range=0..1000)
dam = DataDam(DataA=crv, BufferDelay=10000000, BufferMode=0)
# Turn me on!   -->
concat = Concatenate(FragmentA="C:\Users\Archolic\Anaconda3\envs\rhinoremote", FragmentB="\python.exe")
crv_2 = Curve(dam)
lng = ListLength(List=crv_2)
padding = Slider(0.667, range=0..1)
boundary = BoundarySurfaces(Edges=crv_2)
loop_start = LoopStart(Repeat=lng, Trigger=Toggle(False))  # -> port, Counter, Data
number_slider_2 = Slider(256, range=0..1000)
list = ValueList({"CRITICAL", "ERROR", "WARNING", "INFO", "DEBUG", "NOTSET"}, selected="DEBUG")

# ---- group: Import remote python modules
panel = Panel(python)
panel_2 = Panel("""numpy
requests
scipy
scipy.stats""")
ghpythonremote = GHPythonRemote(location=concat, run=Toggle(True), modules=panel_2, log_level=list, working_dir=panel)  # -> out, linked_modules, rpy; inputs run: Boolean, modules: list
# ---------- ghpythonremote: Python ----------
import sys
import scriptcontext
import logging
import inspect
import ghpythonremote
from ghpythonremote.connectors import GrasshopperToPythonRemote
from os import path
from time import sleep

local_log_level = getattr(logging, log_level, logging.WARNING)
logger = logging.getLogger('ghpythonremote')
logger.setLevel(local_log_level)
ch = logging.StreamHandler()
ch.setLevel(local_log_level)
formatter = logging.Formatter('%(levelname)s: %(name)s:\n%(message)s')
ch.setFormatter(formatter)
logger.handlers = []
logger.addHandler(ch)
logger = logging.getLogger('ghpythonremote.GH_to_python_sticky')

ROOT = path.abspath(path.dirname(inspect.getfile(ghpythonremote)))
rpyc_server_py = path.join(ROOT, 'pythonservice.py')

# Set connection to CLOSED if this is the first run
# and initialize set of linked modules
try:
    remote_python_status
except NameError:
    remote_python_status = 'CLOSED'
    lkd_modules = set()

# Wait for connection to connect or terminate
timer = 0
while remote_python_status == 'CONNECTING' or remote_python_status == 'CLOSING':
    sleep(1)
    timer += 1
    if timer == 10:
        try:
            gh2py_manager.__exit__(*sys.exc_info())
        except Exception:
            pass
        remote_python_status = 'CLOSED'
        lkd_modules = set()
        raise RuntimeError("Connection left in an inconsistent state and not returning. Reset everything.")

if run:
    if not remote_python_status == 'OPEN':
        remote_python_status = 'CONNECTING'
        gh2py_manager = GrasshopperToPythonRemote(rpyc_server_py, location=location, timeout=10,
                                                  port=None, log_level=log_level, working_dir=working_dir)
        gh2py = gh2py_manager.__enter__()
        remote_python_status = 'OPEN'

    # Stuff that we can reach
    rpymod = gh2py.py_remote_modules  # A getter function for a named python module
    rpy = gh2py.connection  # Represents the remote instance root object
    scriptcontext.sticky['rpy'] = rpy
    # Add modules
    for mod in modules:
        try:
            scriptcontext.sticky[mod] = rpymod(mod)
            lkd_modules.add(mod)
        except ImportError:
            gh2py_manager.__exit__(*sys.exc_info())
            raise

elif not remote_python_status == 'CLOSED':
    remote_python_status = 'CLOSING'
    # Remove linked modules
    for mod in lkd_modules:
        del scriptcontext.sticky[mod]
    del scriptcontext.sticky['rpy']
    gh2py_manager.__exit__(*sys.exc_info())
    lkd_modules = set()
    remote_python_status = 'CLOSED'

# Change variable name because ghpython resets outputs to None before each run
linked_modules = lkd_modules

logger.info('GH to python connection is {}'.format(remote_python_status))
# ---------- end ghpythonremote ----------
panel_3 = Panel(ghpythonremote.out)

# ----
dom = ConstructDomain(DomainStart=0, DomainEnd=1)
item = ListItem(List=crv_2, Index=loop_start.Counter, Wrap=True)
range = Range(Domain=dom, Steps=number_slider_2)
python_2 = PythonScript(module_names=ghpythonremote.linked_modules)  # -> import_statements; inputs module_names: list
# ---------- python_2: Python ----------
import_statements = ["import scriptcontext as sc"]
for module_name in module_names:
    import_statements.append("{0} = sc.sticky['{0}']".format(module_name))

if len(module_names) == 0:
    import_statements = []
# ---------- end python_2 ----------
crv_3 = Curve(item)
bbox = BoundingBox(Content=crv_3, Plane=PlaneXY(0, 0, 0))  # -> Box, Box_2
python_3 = GhPythonScript(target_dim=number_slider_2, ratio=padding, box=bbox.Box)  # -> out, rect; inputs target_dim: Int32, box: Box
# ---------- python_3: Python ----------
import rhinoscriptsyntax as rs

center = box.Center

box_x = box.X.Length
box_y = box.Y.Length
box_z = box.Z
print(center.X, type(box_x), box_y)

new_dimension = max(box_x, box_y) * (1 + ratio)

c0 = rs.CreatePoint(center.X - new_dimension, center.Y - new_dimension, center.Z)
c1 = rs.CreatePoint(center.X + new_dimension, center.Y + new_dimension, center.Z)

dx = center.X - new_dimension/2
dy = center.Y - new_dimension/2
dz = center.Z

translation = rs.CreateVector(dx, dy, dz)

plane = box.Plane
rect = rs.AddRectangle(plane, new_dimension, new_dimension)
rect = rs.MoveObject(rect, translation)
# ---------- end python_3 ----------
paramrecgrid = ParameterRectangleGrid(Rectangle=python_3.rect, ParametersX=range, ParametersY=range)  # -> Cells, Points
area = Area(Geometry=simplify(paramrecgrid.Cells))  # -> Area, Centroid
panel_4 = Panel(python_2)
incurve = PointInCurve(Point=area.Centroid, Curve=crv_3)  # -> flatten(Relationship), Point
generate = GhPythonScript(matrix=incurve.Relationship)  # -> out, path, dvec; inputs matrix: tree
# ---------- generate: Python ----------
import scriptcontext as sc
import ghpythonremote as ghr
from ghpythonlib.treehelpers import list_to_tree, tree_to_list
from time import time
import json

tic = time()
# remote imports
rpy = sc.sticky['rpy']
np = sc.sticky['numpy']
rq = sc.sticky['requests']
sp = sc.sticky['scipy.stats']

#path = matrix.Path(3)
#img = np.ones((target_dim, target_dim))

img = tree_to_list(matrix)

payload = json.dumps({"params": img}, sort_keys=True)
response = rq.post("http://127.0.0.1:4453/generate",json=payload)
generated = json.loads(response.json())
dvec= list_to_tree(generated['predicted'], source=[0])
# ---------- end generate ----------
panel_5 = Panel(incurve.Relationship)
multiplication = Multiplication(A=generate.dvec, B=Slider(40, range=0..100))
pt = Point(area.Centroid)
smaller = SmallerThan(FirstNumber=generate.dvec, SecondNumber=0)  # -> SmallerThan, OrEqualTo
panel_6 = Panel(generate.path)
Z = UnitZ(Factor=multiplication)
cull = CullPattern(List=pt, CullPattern=smaller.OrEqualTo)
number_slider_3 = Slider(0.1, range=0..0.1)  # disabled
cull_2 = CullPattern(List=paramrecgrid.Cells, CullPattern=smaller.OrEqualTo)  # -> simplify(List)
move = Move(Geometry=cull, Motion=Z)  # -> Geometry, Transform
viewer = ParamViewer(generate.dvec)
extr = Extrude()
merge = Merge(Data1=loop_start.Data, Data2=move.Geometry)
loop_end = LoopEnd(port=loop_start.port, Exit=False, Data=merge, TimeOutVal=0, pausedState=False, state="Constant output")
pt_2 = Point(Tree({0}: [], {0;0}: [], {0;1}: [], {0;2}: [], {0;3}: [], {0;4}: []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))
viewer_2 = ParamViewer(pt_2)
